# Grasshopper definition Hyperboloid.ghx (Grasshopper 1.0.8)

# ---- group: RH_IN:elipse_x
int = Integer(Slider(78, range=0..100))

# ---- group: RH_IN:elipse_y
int_2 = Integer(Slider(88, range=10..100))

# ----
grab = Grab(On=True, Strength=1, Range=3)

# ---- group: RH_IN:twist_configurator_rings
int_3 = Integer(Slider(121, range=0..180))

# ---- group: RH_IN:configurator_height
int_4 = Integer(Slider(203, range=1..500))

# ----
grab_2 = Grab(On=True, Strength=1, Range=3)
toggle = BooleanToggle(False)
ellipse = Ellipse(Plane=PlaneXY(0, 0, 0), Radius1=int_2, Radius2=int)  # -> Ellipse, Focus1, Focus2
toggle_2 = BooleanToggle(True)
ellipse_2 = Ellipse(Plane=PlaneXY(0, 0, 0), Radius1=int_2, Radius2=int)  # -> Ellipse, Focus1, Focus2

# ---- group: RH_IN:move_a
curvepoint = PointOnCurve(ellipse_2.Ellipse, parameter=0.612)

# ----
oncurve = OnCurve(Points=curvepoint, Curve=ellipse_2.Ellipse, Strength=1)
Z = UnitZ(Factor=int_4)
bouncysolver = BouncySolver(
    GoalObjects=flatten([oncurve, grab]),
    Reset=toggle_2,
    Threshold=1e-15,
    Tolerance=0.0001,
    Damping=0.99,
    Iterations=10,
    On=toggle)  # -> I, V, O
move = Move(Geometry=ellipse_2.Ellipse, Motion=Z)  # -> Geometry, Transform
rad = Radians(Degrees=int_3)
crv_cp = CurveClosestPoint(Point=bouncysolver.V, Curve=ellipse_2.Ellipse)  # -> Point, Parameter, Distance
rad_2 = Radians(Degrees=0)
remap = RemapNumbers(Value=bouncysolver.V, Source="0 to 1", Target="0 to 50")  # -> Mapped, Clipped
rotate = Rotate(Geometry=ellipse.Ellipse, Angle=rad_2, Plane=PlaneXY(0, 0, 0))  # -> Geometry, Transform
rotate_2 = Rotate(Geometry=move.Geometry, Angle=rad, Plane=PlaneXY(0, 0, 0))  # -> Geometry, Transform
divide = DivideCurve(Curve=rotate_2.Geometry, Count=10, Kinks=False)  # -> Points, Tangents, Parameters
divide_2 = DivideCurve(Curve=rotate.Geometry, Count=10, Kinks=False)  # -> Points, Tangents, Parameters
panel = Panel(remap.Mapped)
rulesrf = RuledSurface(CurveA=rotate.Geometry, CurveB=rotate_2.Geometry)
ln = Line(StartPoint=divide_2.Points, EndPoint=divide.Points)
midpt = CurveMiddle(Curve=ln)
nurbs = NurbsCurve(Vertices=midpt, Degree=3, Periodic=True)  # -> Curve, Length, Domain

# ---- group: RH_IN:move_b
curvepoint_2 = PointOnCurve(nurbs.Curve, parameter=0.578)

# ----
oncurve_2 = OnCurve(Points=curvepoint_2, Curve=nurbs.Curve, Strength=1)
bouncysolver_2 = BouncySolver(
    GoalObjects=flatten([oncurve_2, grab_2]),
    Reset=toggle_2,
    Threshold=1e-15,
    Tolerance=0.0001,
    Damping=0.99,
    Iterations=10,
    On=toggle)  # -> I, V, O
remap_2 = RemapNumbers(Value=bouncysolver_2.V, Source="0 to 1", Target="0 to 50")  # -> Mapped, Clipped
crv_cp_2 = CurveClosestPoint(Point=bouncysolver_2.V, Curve=nurbs.Curve)  # -> Point, Parameter, Distance
panel_2 = Panel(remap_2.Mapped)

# ---- group: RH_OUT:points
point = Point([Point(-65.35908541, -52.22923546, 0), Point(20.0077532, -31.07316159, 101.5)])

# ---- group: RH_OUT:Configurator
mesh_brep = MeshBrep(
    Brep=rulesrf,
    Settings={GridMaxCount=0, GridMinCount=16, JaggedSeams=False, MaxEdgeLength=0, MinEdgeLength=0.0001, MinTolerance=0, Refine=True, RefineAngle=0, RelativeTolerance=0.65, SimplePlanes=True, Tolerance=0})

# ----
nurbs_2 = NurbsCurve(Vertices=[crv_cp.Point, crv_cp_2.Point], Degree=1, Periodic=False)  # -> Curve, Length, Domain

# ---- group: RH_IN:move_cone_a
num = Number(Slider(2.125, range=1.5..10))

# ----
pull = PullCurve(Curve=nurbs_2.Curve, Surface=rulesrf)

# ---- group: RH_OUT:hyperboloid
curve = Curve(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)

# ----
midpt_2 = CurveMiddle(Curve=pull)
len = Length(Curve=pull)
pull_2 = PullPoint(Point=midpt_2, Geometry=crv_cp_2.Point, ClosestOnly=True)  # -> ClosestPoint, Distance, Index
line = LineSDL(Start=pull_2.ClosestPoint, Direction=Vector(0, 1, 0), Length=len)

# ---- group: RH_IN:move_cone_b
num_2 = Number(Slider(1.844, range=1..2))

# ----
rot3d = Rotate3D(Geometry=pull, Angle=1.570796327, Center=crv_cp_2.Point, Axis=line)  # -> Geometry, Transform
pi = Pi(Factor=1)
arrcurve = CurveArray(Geometry=rot3d.Geometry, Curve=nurbs.Curve, Count=10)  # -> Geometry, Transform

# ---- group: RH_IN:move_cone_c
num_3 = Number(Slider(5.082, range=1..10))

# ----
loft = Loft(Curves=arrcurve.Geometry, Options={Adjust=True, Closed=True, LoftEnds=0, LoftSimp=0, LoftType=5, Rebuild=10, Refit=0.01})
movetoplane = MoveToPlane(Geometry=loft, Plane=PlaneXY(0, 0, 0), Above=True, Below=True)  # -> Geometry, Transform
edges = BrepEdges(Brep=movetoplane.Geometry)  # -> Naked, Interior, NonManifold
sort = SortList(Keys=edges.Naked, ValuesA=edges.Naked)  # -> Keys, ValuesA
item = ListItem(List=sort.ValuesA, Index="1", Wrap=True)
item_2 = ListItem(List=sort.ValuesA, Index="0", Wrap=True)
srf = Surface(item)
planesrf = PlaneSurface(Plane=item_2, XSize=Domain(-10, 10), YSize=Domain(-10, 10))
edges_2 = BrepEdges(Brep=srf)  # -> Naked, Interior, NonManifold
len_2 = Length(Curve=edges_2.Naked)
division = Division(A=len_2, B=pi)
division_2 = Division(A=division, B=num)
Y = UnitY(Factor=division_2)
move_2 = Move(Geometry=movetoplane.Geometry, Motion=Y)  # -> Geometry, Transform
division_3 = Division(A=division, B=num_2)
X = UnitX(Factor=division_3)
move_3 = Move(Geometry=movetoplane.Geometry, Motion=X)  # -> Geometry, Transform
division_4 = Division(A=division, B=num_3)
Y_2 = UnitY(Factor=division_4)
move_4 = Move(Geometry=move_3.Geometry, Motion=Y_2)  # -> Geometry, Transform
sint = SolidIntersection(BrepsA=move_2.Geometry, BrepsB=movetoplane.Geometry)
sint_2 = SolidIntersection(BrepsA=move_4.Geometry, BrepsB=sint)
Y_3 = UnitY(Factor=Slider(-736, range=-1000..500))
rectangle = Rectangle(Plane=PlaneXY(0, 0, 0), XSize=division, YSize=division, Radius=0)  # -> Rectangle, Length
move_5 = Move(Geometry=sint_2, Motion=Y_3)  # -> Geometry, Transform
arrrec = RectangularArray(Geometry=movetoplane.Geometry, Cell=rectangle.Rectangle, XCount=2, YCount=2)  # -> Geometry, Transform
Z_2 = UnitZ(Factor=1)
capex = CapHolesEx(Brep=arrrec.Geometry)  # -> Brep, Caps, Solid
extr = Extrude(Base=move_5.Geometry, Direction=Z_2)
debrep = DeconstructBrep(Brep=capex.Brep)  # -> Faces, Edges, Vertices

# ---- group: RH_OUT:positive
mesh_brep_2 = MeshBrep(
    Brep=extr,
    Settings={GridMaxCount=0, GridMinCount=16, JaggedSeams=False, MaxEdgeLength=0, MinEdgeLength=0.0001, MinTolerance=0, Refine=True, RefineAngle=0, RelativeTolerance=0.65, SimplePlanes=True, Tolerance=0})

# ----
sort_2 = SortList(Keys=debrep.Vertices, ValuesA=debrep.Vertices)  # -> Keys, ValuesA
sort_pt = SortPoints(Points=sort_2.ValuesA)  # -> Points, Indices
pdecon = Deconstruct(Point=sort_pt.Points)  # -> XComponent, YComponent, flatten(ZComponent)
item_3 = ListItem(List=pdecon.ZComponent, Index=0, Wrap=True)
box = DomainBox(Base=PlaneXY(0, 0, 0), X=division, Y=division, Z=item_3)
sdiff = SolidDifference(BrepsA=box, BrepsB=capex.Brep)
area = Area(Geometry=sdiff)  # -> Area, Centroid
movetoplane_2 = MoveToPlane(Geometry=area.Centroid, Plane=PlaneXY(0, 0, 0), Above=True, Below=True)  # -> Geometry, Transform
move_6 = Move(Geometry=movetoplane.Geometry, Motion=movetoplane_2.Geometry)  # -> Geometry, Transform
capex_2 = CapHolesEx(Brep=move_6.Geometry)  # -> Brep, Caps, Solid
sdiff_2 = SolidDifference(BrepsA=sdiff, BrepsB=capex_2.Brep)
rectangle_2 = Rectangle(Plane=PlaneXY(0, 0, 0), XSize=division, YSize=division, Radius=0)  # -> Rectangle, Length

# ---- group: RH_IN:array_panels
int_5 = Integer(Slider(2, range=0..10))

# ----
arrrec_2 = RectangularArray(Geometry=sdiff_2, Cell=rectangle_2.Rectangle, XCount=int_5, YCount=int_5)  # -> Geometry, Transform
Y_4 = UnitY(Factor=Slider(465, range=0..1000))
move_7 = Move(Geometry=arrrec_2.Geometry, Motion=Y_4)  # -> Geometry, Transform
X_2 = UnitX(Factor=Slider(-160, range=-500..500))
move_8 = Move(Geometry=move_7.Geometry, Motion=X_2)  # -> Geometry, Transform

# ---- group: RH_OUT:panels
# EDIT
mesh_brep_3 = MeshBrep(
    Brep=move_8.Geometry,
    Settings={GridMaxCount=0, GridMinCount=16, JaggedSeams=False, MaxEdgeLength=0, MinEdgeLength=0.0001, MinTolerance=0, Refine=True, RefineAngle=0, RelativeTolerance=0.65, SimplePlanes=True, Tolerance=0})
