# Grasshopper definition TopoOpt.gh (Grasshopper 1.0.8)

# ----
# Drop Brep File (.3dm)
brep = Brep(<brep referenced from the Rhino model>)
mesh_brep = MeshBrep(
    Brep=brep,
    Settings={GridMaxCount=0, GridMinCount=16, JaggedSeams=False, MaxEdgeLength=0, MinEdgeLength=0.0001, MinTolerance=0, Refine=True, RefineAngle=0, RelativeTolerance=0.65, SimplePlanes=True, Tolerance=0})
deconstruct_mesh = DeconstructMesh(Mesh=mesh_brep)  # -> Vertices, Faces, Colours, Normals
deconstruct_brep = DeconstructBrep(Brep=brep)  # -> Faces, Edges, Vertices
sort_list = SortList(Keys=deconstruct_brep.Vertices, ValuesA=deconstruct_brep.Vertices)  # -> Keys, ValuesA
sort_points = SortPoints(Points=sort_list.ValuesA)  # -> Points, Indices
deconstruct = Deconstruct(Point=sort_points.Points)  # -> XComponent, YComponent, ZComponent
maximum = Maximum(A="1", B=deconstruct.ZComponent)
equality = Equality(FirstNumber=deconstruct.ZComponent, SecondNumber=maximum)  # -> Equality, Inequality
cull_pattern = CullPattern(List=sort_points.Points, CullPattern=equality.Inequality)
cull_pattern_2 = CullPattern(List=sort_points.Points, CullPattern=equality.Equality)

unit_z = UnitZ(Factor="9.81")
volume = Volume(Geometry=brep)  # -> Volume, Centroid
xy_plane = XYPlane(Origin=Point(0, 0, 0))
negative = Negative(Value=unit_z)
division = Division(A=volume.Volume, B=Slider(1.5, range=0..1.5))
rigidbody = RigidBody(Part=mesh_brep, Plane=xy_plane, Points=deconstruct_mesh.Vertices, Strength=Slider(9000, range=0..9000))  # -> RigidBody, Planes
anchor = Anchor(Point=cull_pattern, Target=cull_pattern, Strength=Slider(15000, range=0..15000))
load = Load(Point=cull_pattern_2, ForceVector=negative, Weighting=Slider(700, range=0..700))
volume_2 = Volume(Mesh=mesh_brep, Volume=division, Strength=Slider(6500, range=0..6500))
bouncysolver = BouncySolver(
    GoalObjects=[anchor, load, volume_2, rigidbody.RigidBody],
    Reset=Toggle(False),
    Threshold="0.0001",
    Tolerance="0.0001",
    Damping=0.99,
    Iterations=1000,
    On=True)  # -> I, V, O

# ----
# Edit
number_slider = Slider(3.6, range=0..10)
cube = Integer(Slider(0, range=0..1))
segment = Integer(number_slider)
smooth = Integer(Slider(5, range=0..5))
pipe_width = Integer(Slider(1, range=0..10))
round = Integer(Slider(11, range=1..30))
tolerance = Integer(Slider(3, range=1..30))
spacing = Integer(Slider(0, range=0..150))
links = Integer(Slider(3, range=1..5))
proximity_3d = Proximity3D(Points=bouncysolver.V, Group=links, MinRadius=spacing)  # -> flatten(Links), Topology
multipipe = MultiPipe(
    Curves=proximity_3d.Links,
    NodeSize=tolerance,
    SizePoints=bouncysolver.V,
    EndOffset=round,
    StrutSize=pipe_width,
    Segment=segment,
    KinkAngle=0.6,
    CubeFit=cube,
    Caps="1")
mesh_from_subd = MeshFromSubD(SubD=multipipe, Density=smooth)
