# Grasshopper definition topological-optimization.gh (Grasshopper 1.0.8)

# ----
# Drop Brep File (.3dm)
brep = Brep(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)
mesh_brep = MeshBrep(
    Brep=brep,
    Settings={GridMaxCount=0, GridMinCount=16, JaggedSeams=False, MaxEdgeLength=0, MinEdgeLength=0.0001, MinTolerance=0, Refine=True, RefineAngle=0, RelativeTolerance=0.65, SimplePlanes=True, Tolerance=0})
deconstruct_mesh = DeconstructMesh(Mesh=mesh_brep)  # -> Vertices, Faces, Colours, Normals
deconstruct_brep = DeconstructBrep(Brep=brep)  # -> Faces, Edges, Vertices
sort_list = SortList(Keys=deconstruct_brep.Vertices, ValuesValuesA=deconstruct_brep.Vertices)  # -> Keys, ValuesValuesA
sort_points = SortPoints(Points=sort_list.ValuesValuesA)  # -> Points, Indices
deconstruct = Deconstruct(Point=sort_points.Points)  # -> XComponent, YComponent, ZComponent
maximum = Maximum(A="1", B=deconstruct.ZComponent)
equality = Equality(FirstNumber=deconstruct.ZComponent, SecondNumber=maximum)  # -> Equality, Inequality
cull_pattern = CullPattern(List=sort_points.Points, CullPattern=equality.Inequality)
cull_pattern_2 = CullPattern(List=sort_points.Points, CullPattern=equality.Equality)

unit_z = UnitZ(Factor="9.81")
volume = Volume(Geometry=brep)  # -> Volume, Centroid
xy_plane = XYPlane(Origin=Point(0, 0, 0))
negative = Negative(Value=unit_z)
division = Division(A=volume.Volume, B=Slider(1.5, range=0..1.5))
rigidbody = RigidBody(Part=mesh_brep, Plane=xy_plane, Points=deconstruct_mesh.Vertices, Strength=Slider(9000, range=0..9000))  # -> RigidBody, Planes
anchor = Anchor(Point=cull_pattern, Target=cull_pattern, Strength=Slider(15000, range=0..15000))
load = Load(Point=cull_pattern_2, ForceVector=negative, Weighting=Slider(700, range=0..700))
volume_2 = Volume(Mesh=mesh_brep, Volume=division, Strength=Slider(6500, range=0..6500))
bouncysolver = BouncySolver(
    GoalObjects=[anchor, load, volume_2, rigidbody.RigidBody],
    Reset=Toggle(False),
    Threshold="0.0001",
    Tolerance="0.0001",
    Damping=0.99,
    Iterations=1000,
    On=True)  # -> I, V, O

links = GetInteger(Slider(4, range=0..10), AtLeast=1, AtMost=1, Maximum=2147483647, Minimum=-2147483648, TreeAccess=False)
max_r = GetInteger(Slider(500, range=0..500), AtLeast=1, AtMost=1, Maximum=2147483647, Minimum=-2147483648, TreeAccess=False)
min_r = GetInteger(Slider(24, range=0..100), AtLeast=1, AtMost=1, Maximum=2147483647, Minimum=-2147483648, TreeAccess=False)

list_length = ListLength(List=bouncysolver.V)
expression = Expression(x=links, Expression="x+1")
series = Series(Start="0", Step="1", Count=list_length)  # -> graft(Series)
closest_points = ClosestPoints(Point=bouncysolver.V, Cloud=bouncysolver.V, Count=expression)  # -> ClosestPoint, flatten(CPIndex), Distance
graft_tree = GraftTree(Tree=series, IncludeEmptyLists=True, IncludeNullItems=True)
duplicate_data = DuplicateData(Data=graft_tree, Number=expression, Order=True)  # -> flatten(Data)
flatten_tree = FlattenTree(Tree=closest_points.CPIndex, Path="{0}")
flatten_tree_2 = FlattenTree(Tree=duplicate_data, Path="{0}")
equality_2 = Equality(FirstNumber=flatten_tree_2, SecondNumber=flatten_tree)  # -> Equality, Inequality
gate_not = GateNot(A=equality_2.Equality)
cull_pattern_3 = CullPattern(List=closest_points.CPIndex, CullPattern=gate_not)
cull_pattern_4 = CullPattern(List=duplicate_data, CullPattern=gate_not)
smaller_than = SmallerThan(FirstNumber=cull_pattern_4, SecondNumber=cull_pattern_3)  # -> SmallerThan, OrEqualTo
cull_pattern_5 = CullPattern(List=cull_pattern_3, CullPattern=smaller_than.SmallerThan)
cull_pattern_6 = CullPattern(List=cull_pattern_4, CullPattern=smaller_than.SmallerThan)
list_item = ListItem(List=bouncysolver.V, Index=cull_pattern_5, Wrap=False)
list_item_2 = ListItem(List=bouncysolver.V, Index=cull_pattern_6, Wrap=False)
distance = Distance(PointA=list_item_2, PointB=list_item)
smaller_than_2 = SmallerThan(FirstNumber=distance, SecondNumber=max_r)  # -> SmallerThan, OrEqualTo
larger_than = LargerThan(FirstNumber=distance, SecondNumber=min_r)  # -> LargerThan, OrEqualTo
gate_and = GateAnd(A=larger_than.LargerThan, B=smaller_than_2.SmallerThan)
cull_pattern_7 = CullPattern(List=list_item_2, CullPattern=gate_and)
cull_pattern_8 = CullPattern(List=list_item, CullPattern=gate_and)
line = Line(StartPoint=cull_pattern_7, EndPoint=cull_pattern_8)

# ----
# Edit
number_slider = Slider(0, range=0..1)

thickness = GetInteger(Slider(3, range=0..10), AtLeast=1, AtMost=1, Maximum=2147483647, Minimum=-2147483648, TreeAccess=False)
square = GetInteger(Slider(8, range=0..20), AtLeast=1, AtMost=1, Maximum=2147483647, Minimum=-2147483648, TreeAccess=False)
strutsize = GetInteger(Slider(1, range=0..10), AtLeast=1, AtMost=1, Maximum=2147483647, Minimum=-2147483648, TreeAccess=False)
segment = GetInteger(Slider(6, range=0..10), AtLeast=1, AtMost=1, Maximum=2147483647, Minimum=-2147483648, TreeAccess=False)
cubecorners = GetInteger(number_slider, AtLeast=1, AtMost=1, Maximum=2147483647, Minimum=-2147483648, TreeAccess=False)
smooth = GetInteger(Slider(5, range=0..10), AtLeast=1, AtMost=1, Maximum=2147483647, Minimum=-2147483648, TreeAccess=False)

multipipe = MultiPipe(
    Curves=line,
    NodeSize=thickness,
    SizePoints=bouncysolver.V,
    EndOffset=square,
    StrutSize=strutsize,
    Segment=segment,
    KinkAngle=0.6,
    CubeFit=cubecorners,
    Caps="1")
mesh_from_subd = MeshFromSubD(SubD=multipipe, Density=smooth)

context_bake = ContextBake(Content=mesh_from_subd)
